# Grasshopper definition error_handling.gh (Grasshopper 1.0.7)
# Copyright: AMDlab

# 元のスクリプト
panel = Panel("""0
1
2
3
4""")
number_slider = Slider(3.719, range=-10..10)
# 簡単に例外を発生させる
panel_2 = Panel("""0
1
2
3
4""")
number_slider_2 = Slider(-0.283, range=-10..10)
# MessageBoxで目立たせる
panel_3 = Panel("""0
1
2
3
4""")
number_slider_3 = Slider(0, range=-10..10)
# 警告を出す
panel_4 = Panel("""0
1
2
3
4""")
number_slider_4 = Slider(3.133, range=-10..10)
# 型を決める
panel_5 = Panel("""0
1
2
3
4""")
number_slider_5 = Slider(1.292, range=-10..10)
int = Integer(number_slider_5)
python = GhPythonScript(L=panel, i=number_slider)  # -> out, a; inputs L: list
# ---------- python: Python ----------
a = L[int(i)]
# ---------- end python ----------
c_script = CSharpScript(L=panel, i=number_slider)  # -> out, A; inputs L: list
# ---------- c_script: C# ----------
    A = L[(int) (double) i];
# ---------- end c_script ----------
python_2 = GhPythonScript(L=panel_2, i=number_slider_2)  # -> out, a; inputs L: list
# ---------- python_2: Python ----------
int_i = int(i)

if int_i < 0:
    raise Exception("iが0より小さいです。")
if len(L)-1 < int_i:
    raise Exception("iがLのインデックス上限外です。")

a = L[int_i]
# ---------- end python_2 ----------
c_script_2 = CSharpScript(L=panel_2, i=number_slider_2)  # -> out, A; inputs L: list
# ---------- c_script_2: C# ----------
    int intI = (int) (double) i;

    if(intI < 0)
    {
      throw new Exception("iが0より小さいです。");
    }
    if(L.Count - 1 < intI)
    {
      throw new Exception("iがLのインデックス上限外です。");
    }

    A = L[intI];
# ---------- end c_script_2 ----------
python_3 = GhPythonScript(L=panel_3, i=number_slider_3)  # -> out, a; inputs L: list
# ---------- python_3: Python ----------
from System.Windows.Forms import MessageBox

int_i = int(i)

if int_i < 0:
    MessageBox.Show("iが0より小さいです。")
    raise Exception("iが0より小さいです。")
if len(L)-1 < int_i:
    MessageBox.Show("iがLのインデックス上限外です。")
    raise Exception("iがLのインデックス上限外です。")

a = L[int_i]
# ---------- end python_3 ----------
c_script_3 = CSharpScript(L=panel_3, i=number_slider_3)  # -> out, A; inputs L: list
# ---------- c_script_3: C# usings ----------
using System.Windows.Forms;
# ---------- c_script_3: C# ----------
    int intI = (int) (double) i;

    if(intI < 0)
    {
      MessageBox.Show("iが0より小さいです。");
      throw new Exception("iが0より小さいです。");
    }
    if(L.Count - 1 < intI)
    {
      MessageBox.Show("iが0より小さいです。");
      throw new Exception("iがLのインデックス上限外です。");
    }

    A = L[intI];
# ---------- end c_script_3 ----------
python_4 = GhPythonScript(L=panel_4, i=number_slider_4)  # -> out, a; inputs L: list
# ---------- python_4: Python ----------
from Grasshopper.Kernel import GH_RuntimeMessageLevel

int_i = int(i)

if int_i < 0:
    raise Exception("iが0より小さいです。")
if len(L)-1 < int_i:
    raise Exception("iがLのインデックス上限外です。")
if int_i != i:
    ghenv.Component.AddRuntimeMessage(
        GH_RuntimeMessageLevel.Warning,
        "入力iがintでまるめられます。"
    )

a = L[int_i]
# ---------- end python_4 ----------
c_script_4 = CSharpScript(L=panel_4, i=number_slider_4)  # -> out, A; inputs L: list
# ---------- c_script_4: C# ----------
    int intI = (int) (double) i;

    if(intI < 0)
    {
      throw new Exception("iが0より小さいです。");
    }
    if(L.Count - 1 < intI)
    {
      throw new Exception("iがLのインデックス上限外です。");
    }
    if(intI != (double) i)
    {
      Component.AddRuntimeMessage(
        GH_RuntimeMessageLevel.Warning,
        "入力iがintでまるめられます。"
        );
    }

    A = L[intI];
# ---------- end c_script_4 ----------
python_5 = GhPythonScript(L=panel_5, i=int)  # -> out, a; inputs L: list; same code as python_4
c_script_5 = CSharpScript(L=panel_5, i=number_slider_5)  # -> out, A; inputs L: list, i: Int32; same code as c_script_4
item = ListItem(List=panel, Index=number_slider, Wrap=True)
item_2 = ListItem(List=panel_2, Index=number_slider_2, Wrap=True)
item_3 = ListItem(List=panel_3, Index=number_slider_3, Wrap=True)
item_4 = ListItem(List=panel_4, Index=number_slider_4, Wrap=True)
item_5 = ListItem(List=panel_5, Index=number_slider_5, Wrap=True)
panel_6 = Panel(item_2)
panel_7 = Panel(python_2.a)
panel_8 = Panel(c_script_2.A)
panel_9 = Panel(item_3)
panel_10 = Panel(python_3.a)
panel_11 = Panel(c_script_3.A)
panel_12 = Panel(item_4)
panel_13 = Panel(python_4.a)
panel_14 = Panel(c_script_4.A)
panel_15 = Panel(item_5)
panel_16 = Panel(python_5.a)
panel_17 = Panel(c_script_5.A)
panel_18 = Panel(c_script.A)
panel_19 = Panel(item)
panel_20 = Panel(python.a)
panel_21 = Panel(python_2.out)
panel_22 = Panel(python_3.out)
panel_23 = Panel(python_4.out)
panel_24 = Panel(python_5.out)
panel_25 = Panel(c_script_2.out)
panel_26 = Panel(c_script_3.out)
panel_27 = Panel(c_script_4.out)
panel_28 = Panel(c_script_5.out)
